# Grasshopper definition BundlePrototype.gh (Grasshopper 1.0.7)
# plug-ins: Speckle 2

# ----
# Simple Prototype: example using just a single bundle in a commit
commit_with_bundle = Panel("https://speckle.xyz/streams/4f5b4785b0/commits/34700e87c7")
sr = SynchronousReceiver(
    Stream=commit_with_bundle,
    AutoReceive=False,
    KitName="Objects",
    StreamWrapper="https://speckle.xyz/streams/4f5b4785b0/commits/34700e87c7",
    selectedKitName="Objects")  # -> Data, Info
dso = DeconstructSpeckleObject(SpeckleObject=sr.Data, selectedKitName="Objects")  # -> _1e69d528871d9b8d9f8bb0e04191657b, _3a2409765ad998709745d2f2dbbf566b, _994680a63e1df5d257d6a49d4f18c00f, Name

# ----
# Bundle Intro: The Bundle was inspired by the "Commit Overlay" feature within the viewer, with a goal of trying to functionality to basic set of Objects
# 
# The output of a Bundle contains a list of "bundle items" which is a very simple object with information of which speckle stream id to use along with the list of object Ids to pull.
commit_with_bundle_2 = Panel("https://speckle.xyz/streams/4f5b4785b0/commits/34700e87c7")
receive = Receive(
    Stream=commit_with_bundle_2,
    AutoReceive=False,
    CurrentComponentState="up_to_date",
    ExpandOutput=True,
    LastInfoMessage="David Morgan @ 2022-09-14T00:49:11.887Z: testing bundle object (id:34700e87c7)",
    ReceiveOnOpen=False,
    ReceivedCommitId="34700e87c7",
    StreamWrapper="https://speckle.xyz/streams/4f5b4785b0/commits/34700e87c7",
    selectedKitName="Objects")  # -> Info, Data
dso_2 = DeconstructSpeckleObject(SpeckleObject=receive.Data, selectedKitName="Objects")  # -> Items, Name
dso_3 = DeconstructSpeckleObject(SpeckleObject=dso_2.Items, selectedKitName="Objects")  # -> ObjectIds, StreamId

# ----
# Mildly Simple Prototype: example of a commit with a bundle and other objects within it
commit_with_bundle_and_objects = Panel("https://speckle.xyz/streams/4f5b4785b0/commits/44282681f5")
sr_2 = SynchronousReceiver(
    Stream=commit_with_bundle_and_objects,
    AutoReceive=False,
    KitName="Objects",
    StreamWrapper="https://speckle.xyz/streams/4f5b4785b0/commits/44282681f5",
    selectedKitName="Objects")  # -> Data, Info
dso_4 = DeconstructSpeckleObject(SpeckleObject=sr_2.Data, selectedKitName="Objects")  # -> _1e69d528871d9b8d9f8bb0e04191657b, _3a2409765ad998709745d2f2dbbf566b, _994680a63e1df5d257d6a49d4f18c00f, CrazyBox, Name, NormalSphere

# ----
# This is a bit of the tricky part at the moment, which is breaking the typical conversion process and request a list of objects to be pulled down in one action.
# With the bundle items collected the receiver then would need to read loop back around, read each item and convert that object.
# Right now a bundle makes up a list of object ids associated with a specific stream id.
# 
# During the conversion process the bundle will pass along a list of information that should be used to rebuild the stream wrappers.
# Currently when a bundle is converted it it passes it's data into the "ProgressReport" object within the converter. Since a commit could contain other iteams than just the bundle itself, it seemed to make sense to store those additional obejcts to the side and read them in later. This does put a bit of reliance on how the connector handles checking the progress report
panel = Panel("https://speckle.xyz/streams/")
concat = Concatenate(FragmentA=panel, FragmentB=dso_3.StreamId)
concat_2 = Concatenate(FragmentA=concat, FragmentB="/objects/")
concat_3 = Concatenate(FragmentA=concat_2, FragmentB=dso_3.ObjectIds)
panel_2 = Panel(concat_3)
flatten = FlattenTree(Tree=panel_2, Path="{0}")
item = ListItem(List=flatten, Index=0, Wrap=True)
item_2 = ListItem(List=flatten, Index=1, Wrap=True)
item_3 = ListItem(List=flatten, Index=2, Wrap=True)
bundle_item = Panel(item)
bundle_item_2 = Panel(item_2)
bundle_item_3 = Panel(item_3)
receive_2 = Receive(
    Stream=bundle_item_3,
    AutoReceive=False,
    CurrentComponentState="expired",
    ExpandOutput=True,
    ReceiveOnOpen=False,
    StreamWrapper="https://speckle.xyz/streams/d66e18ac8c/objects/3a2409765ad998709745d2f2dbbf566b",
    selectedKitName="Objects")  # -> Info, Data
receive_3 = Receive(
    Stream=bundle_item_2,
    AutoReceive=False,
    CurrentComponentState="expired",
    ExpandOutput=True,
    ReceiveOnOpen=False,
    StreamWrapper="https://speckle.xyz/streams/4f5b4785b0/objects/1e69d528871d9b8d9f8bb0e04191657b",
    selectedKitName="Objects")  # -> Info, Data
receive_4 = Receive(
    Stream=bundle_item,
    AutoReceive=False,
    CurrentComponentState="expired",
    ExpandOutput=True,
    ReceiveOnOpen=False,
    StreamWrapper="https://speckle.xyz/streams/4f5b4785b0/objects/994680a63e1df5d257d6a49d4f18c00f",
    selectedKitName="Objects")  # -> Info, Data
